# Grasshopper definition SpeckleTest.gh (Grasshopper 1.0.7)
# plug-ins: Speckle 2, jSwan

list = Accounts(
    {"No account selected": , "Account (Shashwat.Suri@mottmac.com | https://speckle.xyz)": "e15b948be8", "Account (Shashwat.Suri@mottmac.com | http://localhost)": "ed4089d692"}, selected="Account (Shashwat.Suri@mottmac.com | https://speckle.xyz)",
    selectedId="e15b948be8",
    selectedServer="https://speckle.xyz")
sget = StreamGet(StreamIDURL="https://speckle.xyz/streams/49452353e6", Account=list)
receive = Receive(
    Stream=sget,
    AutoReceive=False,
    CurrentComponentState="up_to_date",
    KitName="Objects",
    LastInfoMessage="Shashwat Suri @ 2021-11-05T21:13:33.019Z: speckle xyz bart sample (id:ffb52898cf)",
    ReceivedCommitId="ffb52898cf",
    StreamWrapper="https://speckle.xyz/streams/49452353e6?u=e15b948be8",
    selectedKitName="Objects")  # -> Data, Info
srl = Serialize(Base=receive.Data)
dejson = DeserializeJson(JSON=srl, OutputsLocked=False)  # -> TotalChildrenCount, Speckle_type, Units, CROAD, Id
dejson_2 = DeserializeJson(JSON=dejson.CROAD, OutputsLocked=False)  # -> BaseCurve, Name, StartStation, EndStation, StationEquations, StationEquationDirections, Units, TotalChildrenCount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
deserialize = Deserialize(Json=dejson_2.BaseCurve)
to_native = ToNative(Base=deserialize, selectedKitName="Objects")
